# Grasshopper definition 3DModelGenerator-Sband.gh (Grasshopper 1.0.7)

# All units in mm
S = Slider(71.5, range=0..100)
hs = Slider(2, range=0..100)
W = Slider(47, range=0..100)
rh = Slider(12, range=0..100)
L = Slider(22.55, range=0..100)
yf = Slider(3.27, range=0..100)
thickness = Slider(0.8, range=0..100)
undercut = Slider(0.8, range=0..1)
number_slider = Slider(2, range=0..10)
division = Division(A=thickness, B=number_slider)
subtraction = Subtraction(A=L, B=division)
division_2 = Division(A=subtraction, B=number_slider)
subtraction_2 = Subtraction(A=division_2, B=yf)
construct_point = ConstructPoint(XCoordinate=subtraction_2, YCoordinate=0, ZCoordinate=0)
multiplication = Multiplication(A=rh, B=number_slider)
subtraction_3 = Subtraction(A=rh, B=thickness)
division_3 = Division(A=subtraction, B=multiplication)
arcsine = ArcSine(Value=division_3)
construct_domain = ConstructDomain(DomainStart=expr("-x/2", S), DomainEnd=expr("x/2", S))
cosine = Cosine(Value=arcsine)
circle = Circle(Plane=PlaneXY(0, 0, 0), Radius=expr("x/2", S))
unit_z = UnitZ(Factor=hs)
unit_y = UnitY(Factor=W)
subtraction_4 = Subtraction(A=Slider(1, range=0..1), B=cosine)
unit_y_2 = UnitY(Factor=W)

# ---- group: Rh
multiplication_2 = Multiplication(A=rh, B=subtraction_4)

# ----
addition = Addition(A=hs, B=multiplication_2)
subtraction_5 = Subtraction(A=addition, B=rh)
construct_point_2 = ConstructPoint(XCoordinate=0, YCoordinate=expr("-x/2", W), ZCoordinate=subtraction_5)
xz_plane = XZPlane(Origin=construct_point_2)
xz_plane_2 = XZPlane(Origin=construct_point_2)
circle_2 = Circle(Plane=xz_plane_2, Radius=subtraction_3)
circle_3 = Circle(Plane=xz_plane, Radius=rh)
rectangle = Rectangle(Plane=PlaneXY(0, 0, 0), XSize=construct_domain, YSize=construct_domain, Radius=0)  # -> Rectangle, Length
extrude = Extrude(Base=circle, Direction=unit_z)
extrude_2 = Extrude(Base=circle_3, Direction=unit_y)
extrude_3 = Extrude(Base=circle_2, Direction=unit_y_2)
cap_holes = CapHoles(Brep=extrude)
addition_2 = Addition(A=undercut, B=hs)
cap_holes_2 = CapHoles(Brep=extrude_2)
cap_holes_3 = CapHoles(Brep=extrude_3)
unit_z_2 = UnitZ(Factor=addition_2)
circle_4 = Circle(Plane=construct_point, Radius=Slider(1, range=0..1))
split_brep_multiple = SplitBrepMultiple(Brep=cap_holes_2, Cutters=cap_holes)
split_brep_multiple_2 = SplitBrepMultiple(Brep=cap_holes_3, Cutters=cap_holes)
unit_z_3 = UnitZ(Factor=Slider(20, range=0..100))
extrude_4 = Extrude(Base=rectangle.Rectangle, Direction=unit_z_2)
extrude_5 = Extrude(Base=circle_4, Direction=unit_z_3)
list_item = ListItem(List=split_brep_multiple, Index=Slider(1, range=0..10), Wrap=True)
list_item_2 = ListItem(List=split_brep_multiple_2, Index=Slider(1, range=0..10), Wrap=True)
cap_holes_4 = CapHoles(Brep=extrude_5)
cap_holes_5 = CapHoles(Brep=extrude_4)
cap_holes_6 = CapHoles(Brep=list_item)
cap_holes_7 = CapHoles(Brep=list_item_2)
solid_union = SolidUnion(Breps=flatten([cap_holes_7, cap_holes]))
solid_difference = SolidDifference(BrepsA=cap_holes_6, BrepsB=flatten([cap_holes_7, cap_holes_5]))  # -> flatten(Result)
solid_difference_2 = SolidDifference(BrepsA=solid_union, BrepsB=cap_holes_4)
solid_difference_3 = SolidDifference(BrepsA=solid_difference, BrepsB=cap_holes_4)
