# Grasshopper definition Sband-Pathing.gh (Grasshopper 1.0.7)

number_slider = Slider(100, range=0..100)
radiation_element_height = Slider(0.8, range=0..1)
layer_height = Slider(0.2, range=0..1)
surface = Surface(<surface referenced from the Rhino model>)
construct_domain = ConstructDomain(DomainStart=-10, DomainEnd=number_slider)
construct_domain_2 = ConstructDomain(DomainStart=-10, DomainEnd=number_slider)
division = Division(A=radiation_element_height, B=layer_height)
flip = Flip(Surface=surface)  # -> Surface, Result
series = Series(Start=layer_height, Step=layer_height, Count=division)
offset_surface = OffsetSurface(Surface=flip.Surface, Distance=series, Retrim=True)
list_length = ListLength(List=offset_surface)
random = Random(Range=construct_domain, Number=list_length, Seed=2)
random_2 = Random(Range=construct_domain_2, Number=list_length, Seed=Slider(75, range=0..100))
construct_point = ConstructPoint(XCoordinate=random, YCoordinate=random_2, ZCoordinate=0)
point = Point(Point(-23.24648972, -13.8237243, 0))
list_item = ListItem(List=offset_surface, Index=0, Wrap=True)
contour = Contour(Shape=graft(offset_surface), Point=point, Direction=graft(construct_point), Distance=Slider(0.4, range=0..2))
simplify_tree = SimplifyTree(Tree=contour, Front=False)
trim_tree = TrimTree(Tree=simplify_tree, Depth=1)
explode_tree = ExplodeTree(Data=trim_tree)  # -> Branch0, Branch1, Branch2, Branch3
param_viewer = ParamViewer(trim_tree)
cluster = Cluster(curve=explode_tree.Branch1, list=explode_tree.Branch1)
cluster_2 = Cluster(curve=explode_tree.Branch2, list=explode_tree.Branch2)
cluster_3 = Cluster(curve=explode_tree.Branch0, list=explode_tree.Branch0)
cluster_4 = Cluster(curve=explode_tree.Branch3, list=explode_tree.Branch3)
curve = Curve(cluster_4)
curve_2 = Curve(cluster_2)
curve_3 = Curve(cluster)
curve_4 = Curve(cluster_3)

# ==== cluster Cluster
list = ClusterInput()
curve = ClusterInput()
list_length = ListLength(List=list)
curve_2 = Curve(curve)
list_length_2 = ListLength(List=curve_2)
modulus = Modulus(A=list_length, B=Slider(2, range=0..10))
larger_than = LargerThan(FirstNumber=modulus, SecondNumber=Slider(0, range=0..100))  # -> LargerThan, OrEqualTo
cull_index = CullIndex(List=curve_2, Indices=list_length_2, Wrap=True)
stream_filter = StreamFilter(Gate=larger_than.LargerThan, Stream0=curve_2, Stream1=cull_index)
dispatch = Dispatch(List=stream_filter, DispatchPattern=[True, False])  # -> ListA, ListB
end_points = EndPoints(Curve=dispatch.ListB)  # -> Start, End
end_points_2 = EndPoints(Curve=dispatch.ListA)  # -> Start, End
longest_list = LongestList(PaddingMode=2)  # -> ListListA, ListListB, ListA
shift_list = ShiftList(List=end_points_2.Start, Shift=1, Wrap=False)
line = Line(StartPoint=flatten(end_points_2.End), EndPoint=flatten(end_points.End))
line_2 = Line(StartPoint=shift_list, EndPoint=end_points.Start)
list_length_3 = ListLength(List=line_2)  # -> expr("x-1", Length)
cull_index_2 = CullIndex(List=line_2, Indices=list_length_3, Wrap=True)
join_curves = JoinCurves(Curves=flatten([cull_index_2, line, dispatch.ListB, dispatch.ListA]), Preserve=False)
curves = ClusterOutput(join_curves)
