# Grasshopper definition UWBDesignAndPathing.gh (Grasshopper 1.0.7)
# plug-ins: Pufferfish

lb = Slider(4.5, range=0..10)
r2 = Slider(3.5, range=0..10)
r3 = Slider(3.25, range=0..10)
r1 = Slider(10, range=0..10)
lp = Slider(15, range=0..100)
ws = Slider(29, range=0..100)
r4 = Slider(2.8, range=0..10)
w = Slider(3, range=0..10)
w2 = Slider(4.5, range=0..10)
h = Slider(5, range=0..10)
lg = Slider(14.7, range=0..100)

# ---- group: Substrate
length = Slider(36, range=0..100)
ts = Slider(1.27, range=0..10)
start_value = Slider(26, range=0..100, expression="-x")
curve_points = Slider(400, range=0..1000)

# ----
b = Slider(10, range=0..10)
bs = Slider(28.1, range=0..100)
ls = Slider(39, range=0..100)
t = Slider(0.8, range=0..1)
layer_height = Slider(0.2, range=0..1)
division = Division(A=length, B=curve_points)

# ---- group: Substrate (Needs updating)
division_2 = Division(A=bs, B=2)
construct_point = ConstructPoint(XCoordinate=0, YCoordinate=b, ZCoordinate=0)
negative = Negative(Value=division_2)
construct_point_2 = ConstructPoint(XCoordinate=division_2, YCoordinate=0, ZCoordinate=0)
construct_point_3 = ConstructPoint(XCoordinate=negative, YCoordinate=0, ZCoordinate=0)
point = Point([construct_point_2, construct_point, construct_point_3])
interpolate = Interpolate(Vertices=point, Degree=3, Periodic=False, KnotStyle=1)  # -> Curve, Length, Domain
unit_z = UnitZ(Factor=ls)
extrude = Extrude(Base=interpolate.Curve, Direction=unit_z)
flip = Flip(Surface=extrude)  # -> Surface, Result
offset_surface = OffsetSurface(Surface=flip.Surface, Distance=ts, Retrim=True)
brep_edges = BrepEdges(Brep=extrude)  # -> Naked, Interior, NonManifold
brep_edges_2 = BrepEdges(Brep=offset_surface)  # -> Naked, Interior, NonManifold
join_curves = JoinCurves(Curves=brep_edges.Naked, Preserve=False)
join_curves_2 = JoinCurves(Curves=brep_edges_2.Naked, Preserve=False)
loft = Loft(
    Curves=[join_curves, join_curves_2],
    Options={Adjust=False, Closed=False, LoftEnds=0, LoftSimp=0, LoftType=0, Rebuild=10, Refit=0.01})
brep_join = BrepJoin(Breps=flatten([extrude, loft, offset_surface]))  # -> Breps, Closed

# ----
series = Series(Start=start_value, Step=division, Count=curve_points)

# ---- group: Mid circle (f12)
number_slider = Slider(0.1, range=0..0.1)
negative_2 = Negative(Value=r2)
subtraction = Subtraction(A=negative_2, B=r2)
division_3 = Division(A=subtraction, B=number_slider)
series_2 = Series(Start=negative_2, Step=number_slider, Count=expr("abs(x)+1", division_3))
evaluate = Evaluate(Expression="-sqrt(abs(R2²-x²))", R2=r2, x=series_2)
construct_point_4 = ConstructPoint(XCoordinate=series_2, YCoordinate=0, ZCoordinate=evaluate)
interpolate_2 = Interpolate(Vertices=construct_point_4, Degree=3, Periodic=False, KnotStyle=1)  # -> Curve, Length, Domain

# ---- group: Right Top Round (f13)
number_slider_2 = Slider(0.1, range=0..0.1)
subtraction_2 = Subtraction(A=r2, B=r1)
division_4 = Division(A=subtraction_2, B=number_slider_2)
series_3 = Series(Start=r2, Step=number_slider_2, Count=expr("abs(x)+1", division_4))
evaluate_2 = Evaluate(Expression="Lb + sqrt(abs(R3²-(x+R3-R1)²))", Lb=lb, R3=r3, x=series_3, R1=r1)
construct_point_5 = ConstructPoint(XCoordinate=series_3, YCoordinate=0, ZCoordinate=evaluate_2)
interpolate_3 = Interpolate(Vertices=construct_point_5, Degree=3, Periodic=False, KnotStyle=1)  # -> Curve, Length, Domain

# ---- group: Left Top Round (f11)
number_slider_3 = Slider(0.1, range=0..0.1)
negative_3 = Negative(Value=r1)
negative_4 = Negative(Value=r2)
subtraction_3 = Subtraction(A=negative_3, B=negative_4)
division_5 = Division(A=subtraction_3, B=number_slider_3)
series_4 = Series(Start=negative_3, Step=number_slider_3, Count=expr("abs(x)+1", division_5))
evaluate_3 = Evaluate(Expression="Lb + sqrt(abs(R3²-(x-R3+R1)²))", Lb=lb, R3=r3, x=series_4, R1=r1)
construct_point_6 = ConstructPoint(XCoordinate=series_4, YCoordinate=0, ZCoordinate=evaluate_3)
interpolate_4 = Interpolate(Vertices=construct_point_6, Degree=3, Periodic=False, KnotStyle=1)  # -> Curve, Length, Domain

# ----
division_6 = Division(A=series, B=Slider(1000, range=0..1000))
addition = Addition(A=division_6, B=Slider(0.013, range=-10..10))
multiplication = Multiplication(A=addition, B=Slider(40, range=-10..100))
power_of_e = PowerOfE(Value=multiplication)
unit_z_2 = UnitZ(Factor=start_value)
negative_5 = Negative(Value=unit_z_2)
square = Square(Value=power_of_e)
negative_6 = Negative(Value=Slider(2, range=0..10))
multiplication_2 = Multiplication(A=square, B=negative_6)
construct_point_7 = ConstructPoint(XCoordinate=0, YCoordinate=multiplication_2, ZCoordinate=series)
interpolate_5 = Interpolate(Vertices=construct_point_7, Degree=3, Periodic=False, KnotStyle=1)  # -> Curve, Length, Domain
data_dam = DataDam(DataDataA=interpolate_5.Curve, BufferDelay=10000000, BufferMode=0)
division_7 = Division(A=multiplication_2, B=Slider(1000, range=0..1000))
move = Move(Geometry=data_dam, Motion=negative_5)  # -> Geometry, Transform
extrude_along = ExtrudeAlong(Base=interpolate.Curve, Curve=move.Geometry)
offset_surface_2 = OffsetSurface(Surface=extrude_along, Distance=ts, Retrim=True)
end_points = EndPoints(Curve=interpolate_3.Curve)  # -> Start, End
end_points_2 = EndPoints(Curve=interpolate_2.Curve)  # -> Start, End
end_points_3 = EndPoints(Curve=interpolate_4.Curve)  # -> Start, End
brep_edges_3 = BrepEdges(Brep=offset_surface_2)  # -> Naked, Interior, NonManifold
brep_edges_4 = BrepEdges(Brep=extrude_along)  # -> Naked, Interior, NonManifold

# ---- group: Top parasitc element (f21)
number_slider_4 = Slider(0.1, range=0..0.1)
negative_7 = Negative(Value=r4)
subtraction_4 = Subtraction(A=negative_7, B=r4)
division_8 = Division(A=subtraction_4, B=number_slider_4)
series_5 = Series(Start=negative_7, Step=number_slider_4, Count=expr("abs(x)+1", division_8))
evaluate_4 = Evaluate(Expression="-sqrt(abs(R4²-x²))", R4=r4, x=series_5)
construct_point_8 = ConstructPoint(XCoordinate=series_5, YCoordinate=0, ZCoordinate=evaluate_4)
interpolate_6 = Interpolate(Vertices=construct_point_8, Degree=3, Periodic=False, KnotStyle=1)  # -> Curve, Length, Domain

number_slider_5 = Slider(0.1, range=0..0.1)
negative_8 = Negative(Value=r4)
subtraction_5 = Subtraction(A=negative_8, B=r4)
division_9 = Division(A=subtraction_5, B=number_slider_5)
series_6 = Series(Start=negative_8, Step=number_slider_5, Count=expr("abs(x)+1", division_9))
evaluate_5 = Evaluate(Expression="+sqrt(abs(R4²-x²))", R4=r4, x=series_6)
construct_point_9 = ConstructPoint(XCoordinate=series_6, YCoordinate=0, ZCoordinate=evaluate_5)
interpolate_7 = Interpolate(Vertices=construct_point_9, Degree=3, Periodic=False, KnotStyle=1)  # -> Curve, Length, Domain

# ----
join_curves_3 = JoinCurves(Curves=brep_edges_3.Naked, Preserve=False)
join_curves_4 = JoinCurves(Curves=brep_edges_4.Naked, Preserve=False)
loft_2 = Loft(
    Curves=[join_curves_3, join_curves_4],
    Options={Adjust=False, Closed=False, LoftEnds=0, LoftSimp=0, LoftType=0, Rebuild=10, Refit=0.01})
brep_join_2 = BrepJoin(Breps=flatten([loft_2, offset_surface_2, extrude_along]))  # -> Breps, Closed
construct_point_10 = ConstructPoint(XCoordinate=Slider(0.6, range=0..1), YCoordinate=0, ZCoordinate=0)
unit_z_3 = UnitZ(Factor=Slider(3, range=0..10))
negative_9 = Negative(Value=w)
negative_10 = Negative(Value=w)
negative_11 = Negative(Value=w)
division_10 = Division(A=negative_10, B=2)

# ---- group: Left Bottom round (f31)
number_slider_6 = Slider(0.1, range=0..0.1)
negative_12 = Negative(Value=division_10)
subtraction_6 = Subtraction(A=negative_12, B=r1)
division_11 = Division(A=subtraction_6, B=number_slider_6)
series_7 = Series(Start=negative_12, Step=number_slider_6, Count=expr("abs(x)+1", division_11))
evaluate_6 = Evaluate(Expression="-sqrt(abs(R1²-x²))", R1=r1, x=series_7)
construct_point_11 = ConstructPoint(XCoordinate=series_7, YCoordinate=0, ZCoordinate=evaluate_6)
interpolate_8 = Interpolate(Vertices=construct_point_11, Degree=3, Periodic=False, KnotStyle=1)  # -> Curve, Length, Domain

# ----
division_12 = Division(A=negative_11, B=2)

# ---- group: Straight Bottom straaight (f32)
number_slider_7 = Slider(0.1, range=0..0.1)
negative_13 = Negative(Value=division_12)
subtraction_7 = Subtraction(A=division_12, B=negative_13)
division_13 = Division(A=subtraction_7, B=number_slider_7)
series_8 = Series(Start=division_12, Step=number_slider_7, Count=expr("abs(x)+1", division_13))
evaluate_7 = Evaluate(Expression="-Lp+h", Lp=lp, h=h)
construct_point_12 = ConstructPoint(XCoordinate=series_8, YCoordinate=0, ZCoordinate=evaluate_7)
interpolate_9 = Interpolate(Vertices=construct_point_12, Degree=3, Periodic=False, KnotStyle=1)  # -> Curve, Length, Domain

# ----
division_14 = Division(A=negative_9, B=2)

# ---- group: Left Bottom round (f31)
number_slider_8 = Slider(0.1, range=0..0.1)
negative_14 = Negative(Value=r1)
subtraction_8 = Subtraction(A=negative_14, B=division_14)
division_15 = Division(A=subtraction_8, B=number_slider_8)
series_9 = Series(Start=negative_14, Step=number_slider_8, Count=expr("abs(x)+1", division_15))
evaluate_8 = Evaluate(Expression="-sqrt(abs(R1²-x²))", R1=r1, x=series_9)
construct_point_13 = ConstructPoint(XCoordinate=series_9, YCoordinate=0, ZCoordinate=evaluate_8)
interpolate_10 = Interpolate(Vertices=construct_point_13, Degree=3, Periodic=False, KnotStyle=1)  # -> Curve, Length, Domain

# ----
end_points_4 = EndPoints(Curve=interpolate_10.Curve)  # -> Start, End
end_points_5 = EndPoints(Curve=interpolate_8.Curve)  # -> Start, End
line = Line(StartPoint=end_points.Start, EndPoint=end_points_2.End)
line_2 = Line(StartPoint=end_points_3.Start, EndPoint=end_points_4.Start)
line_3 = Line(StartPoint=end_points_4.End, EndPoint=end_points_5.Start)
line_4 = Line(StartPoint=end_points_2.Start, EndPoint=end_points_3.End)
line_5 = Line(StartPoint=end_points.End, EndPoint=end_points_5.End)
unit_y = UnitY(Factor=Slider(20, range=0..100))
number_slider_9 = Slider(0.2, range=0..1)

# ---- group: Parasitic element
join_curves_5 = JoinCurves(Curves=flatten([interpolate_7.Curve, interpolate_6.Curve]), Preserve=False)

# ---- group: Antenna Element
join_curves_6 = JoinCurves(
    Curves=flatten([line_2, line_3, line, line_4, line_5, interpolate_10.Curve, interpolate_8.Curve, interpolate_4.Curve, interpolate_2.Curve, interpolate_3.Curve]),
    Preserve=False)

# ----
xz_plane = XZPlane(Origin=Point(0, 0, 0))
offset_curve = OffsetCurve(Curve=join_curves_5, Distance=number_slider_9, Plane=xz_plane, Corners=1)
boundary_surfaces = BoundarySurfaces(Edges=join_curves_6)
boundary_surfaces_2 = BoundarySurfaces(Edges=join_curves_5)
unit_y_2 = UnitY(Factor=1)
number_slider_10 = Slider(0.45, range=0..1)
number_slider_11 = Slider(0, range=0..100)
division_16 = Division(A=r4, B=1)
division_17 = Division(A=division_16, B=number_slider_10)
number_slider_12 = Slider(7, range=0..10)
series_10 = Series(Start=Slider(0.2, range=0..1), Step=number_slider_10, Count=division_17)
series_11 = Series(Start=number_slider_12, Step=number_slider_12, Count=division_17)
point_2 = Point(Point(0.1239871873, 35.24822939, 11.86277054))
point_3 = Point(Point(-0.02202485734, -0.01947835249, 12.27524593))
division_18 = Division(A=t, B=layer_height)
multiplication_3 = Multiplication(A=layer_height, B=Slider(2, range=0..10))
series_12 = Series(Start=multiplication_3, Step=layer_height, Count=expr("x-1", division_18))

# ---- group: Tranmission lines
last_index = LastIndex(List=construct_point_11)
list_item = ListItem(List=construct_point_11, Index=0, Wrap=True)
list_item_2 = ListItem(List=construct_point_13, Index=last_index, Wrap=True)
deconstruct = Deconstruct(Point=list_item_2)  # -> XComponent, YComponent, ZComponent
negative_15 = Negative(Value=w)
subtraction_9 = Subtraction(A=lp, B=h)
subtraction_10 = Subtraction(A=deconstruct.ZComponent, B=subtraction_9)
division_19 = Division(A=negative_15, B=2)
construct_point_14 = ConstructPoint(XCoordinate=expr("-x", division_19), YCoordinate=0, ZCoordinate=subtraction_10)
construct_point_15 = ConstructPoint(XCoordinate=division_19, YCoordinate=0, ZCoordinate=subtraction_10)
line_6 = Line(StartPoint=list_item_2, EndPoint=list_item)
line_7 = Line(StartPoint=construct_point_15, EndPoint=list_item_2)
line_8 = Line(StartPoint=construct_point_14, EndPoint=list_item)
negative_16 = Negative(Value=w2)
line_9 = Line(StartPoint=construct_point_15, EndPoint=construct_point_14)
division_20 = Division(A=negative_16, B=2)
deconstruct_2 = Deconstruct(Point=construct_point_15)  # -> XComponent, YComponent, ZComponent
construct_point_16 = ConstructPoint(XCoordinate=expr("-x", division_20), YCoordinate=0, ZCoordinate=deconstruct_2.ZComponent)
construct_point_17 = ConstructPoint(XCoordinate=division_20, YCoordinate=0, ZCoordinate=deconstruct_2.ZComponent)
subtraction_11 = Subtraction(A=deconstruct_2.ZComponent, B=h)
construct_point_18 = ConstructPoint(XCoordinate=division_20, YCoordinate=0, ZCoordinate=subtraction_11)
construct_point_19 = ConstructPoint(XCoordinate=expr("-x", division_20), YCoordinate=0, ZCoordinate=subtraction_11)
line_10 = Line(StartPoint=construct_point_18, EndPoint=construct_point_19)
line_11 = Line(StartPoint=construct_point_16, EndPoint=construct_point_19)
line_12 = Line(StartPoint=construct_point_17, EndPoint=construct_point_16)
line_13 = Line(StartPoint=construct_point_18, EndPoint=construct_point_17)

# ----
curve_middle = CurveMiddle(Curve=line_10)
move_2 = Move(Geometry=curve_middle, Motion=construct_point_10)  # -> Geometry, Transform
move_3 = Move(Geometry=curve_middle, Motion=expr("-x", construct_point_10))  # -> Geometry, Transform

# ---- group: Tranmission lines / Tranmission line thin
join_curves_7 = JoinCurves(Curves=[line_7, line_8, line_9, line_6], Preserve=False)

# ---- group: Tranmission lines / Tranmission line thick
join_curves_8 = JoinCurves(Curves=[line_10, line_13, line_12, line_11], Preserve=False)

# ----
line_14 = Line(StartPoint=move_2.Geometry, EndPoint=move_3.Geometry)

# ---- group: Tranmission lines (continued)
boundary_surfaces_3 = BoundarySurfaces(Edges=join_curves_7)
boundary_surfaces_4 = BoundarySurfaces(Edges=join_curves_8)

# ----
extrude_2 = Extrude(Base=line_14, Direction=unit_z_3)
brep_edges_5 = BrepEdges(Brep=extrude_2)  # -> Naked, Interior, NonManifold
surface_split = SurfaceSplit(Surface=boundary_surfaces_4)
join_curves_9 = JoinCurves(Curves=brep_edges_5.Naked, Preserve=False)
list_item_3 = ListItem(List=surface_split, Index=0, Wrap=True)
unit_z_4 = UnitZ(Factor=expr("x-0.1", subtraction_11))
construct_point_20 = ConstructPoint(XCoordinate=0, YCoordinate=unit_y, ZCoordinate=expr("-x", unit_z_4))
move_4 = Move(Geometry=brep_join_2.Breps, Motion=construct_point_20)  # -> Geometry, Transform
brep_join_3 = BrepJoin(Breps=flatten([boundary_surfaces_3, boundary_surfaces, list_item_3]))  # -> Breps, Closed
brep_edges_6 = BrepEdges(Brep=brep_join_3.Breps)  # -> Naked, Interior, NonManifold
join_curves_10 = JoinCurves(Curves=brep_edges_6.Naked, Preserve=False)
offset_curve_2 = OffsetCurve(Curve=join_curves_10, Distance=expr("-x", number_slider_9), Plane=xz_plane, Corners=1)
project = Project(Curve=offset_curve, Brep=move_4.Geometry, Direction=unit_y_2)
deconstruct_brep = DeconstructBrep(Brep=move_4.Geometry)  # -> Faces, Edges, Vertices
project_2 = Project(Curve=offset_curve_2, Brep=move_4.Geometry, Direction=unit_y_2)
offset_curve_3 = OffsetCurve(Curve=offset_curve_2, Distance=expr("-x", Slider(0.2, range=0..1)), Corners=1)
project_3 = Project(Curve=offset_curve_3, Brep=move_4.Geometry, Direction=unit_y_2)
list_item_4 = ListItem(List=project_3, Index=0, Wrap=True)
list_item_5 = ListItem(List=project, Index=number_slider_11, Wrap=True)
list_item_6 = ListItem(List=deconstruct_brep.Faces, Index=number_slider_11, Wrap=True)
offset_curve_from_surface = OffsetCurveFromSurface(Curve=list_item_5, Surface=list_item_6, Distance=expr("x", layer_height), BothSides=0, CapType=1)
surface_split_2 = SurfaceSplit(Surface=list_item_6, Curves=list_item_4)
list_item_7 = ListItem(List=surface_split_2, Index=expr("1", 0), Wrap=True)
offset_surface_3 = OffsetSurface(Surface=list_item_7, Distance=layer_height, Retrim=True)
contour = Contour(Shape=offset_surface_3, Point=point_2, Direction=point_3, Distance=Slider(0.38, range=0..1))
brep_edges_7 = BrepEdges(Brep=offset_surface_3)  # -> Naked, Interior, NonManifold
simplify_tree = SimplifyTree(Tree=contour, Front=False)
cull_index = CullIndex(List=simplify_tree, Indices=Slider(0, range=0..100), Wrap=True)  # -> flatten(List)
curve = Curve(brep_edges_7.Naked)
list_item_8 = ListItem(List=simplify_tree, Index=Slider(0, range=0..100), Wrap=True)  # -> flatten(Item)
join_curves_11 = JoinCurves(Curves=curve, Preserve=False)
offset_on_srf = OffsetOnSrf(Curve=offset_curve_from_surface, Distance=series_10, Surface=list_item_6)  # -> flatten(Curve)
cluster = Cluster(curve=cull_index, list=cull_index)
cluster_2 = Cluster(curve=list_item_8, list=list_item_8)
list_item_9 = ListItem(List=project_2, Index=Slider(0, range=0..100), Wrap=True)
offset_curve_from_surface_2 = OffsetCurveFromSurface(Curve=offset_on_srf, Surface=list_item_6, Distance=graft(layer_height), BothSides=0, CapType=0)  # -> flatten(Offset)
offset_curve_from_surface_3 = OffsetCurveFromSurface(Curve=list_item_9, Surface=list_item_6, Distance=expr("x", graft(layer_height)), BothSides=0, CapType=0)
offset_curve_from_surface_4 = OffsetCurveFromSurface(Curve=list_item_9, Surface=list_item_6, Distance=expr("x", graft(series_12)), BothSides=0, CapType=0)
offset_curve_from_surface_5 = OffsetCurveFromSurface(Curve=cluster_2, Surface=list_item_6, Distance=expr("x", graft(series_12)), BothSides=0, CapType=0)
offset_curve_from_surface_6 = OffsetCurveFromSurface(Curve=cluster, Surface=list_item_6, Distance=expr("x", graft(series_12)), BothSides=0, CapType=0)
offset_curve_from_surface_7 = OffsetCurveFromSurface(Curve=offset_curve_from_surface_2, Surface=list_item_6, Distance=expr("x", graft(series_12)), BothSides=0, CapType=0)
curve_2 = Curve(flatten([offset_curve_from_surface_3, offset_curve_from_surface_4]))
curve_3 = Curve(flatten([cluster_2, offset_curve_from_surface_5]))
curve_4 = Curve(flatten([cluster, offset_curve_from_surface_6]))
list_item_10 = ListItem(List=curve_2, Index=0, Wrap=True)  # -> Item, Item1, Item2, Item3
list_item_11 = ListItem(List=curve_3, Index=0, Wrap=True)  # -> Item, Item1, Item2, Item3
list_item_12 = ListItem(List=curve_4, Index=0, Wrap=True)  # -> Item, Item1, Item2, Item3
curve_5 = Curve([list_item_10.Item1, list_item_11.Item1, list_item_12.Item1])
curve_6 = Curve(flatten([offset_curve_from_surface_2, offset_curve_from_surface_7]))
curve_7 = Curve([list_item_10.Item2, list_item_11.Item2, list_item_12.Item2])
curve_8 = Curve([list_item_10.Item, list_item_11.Item, list_item_12.Item])
curve_9 = Curve([list_item_10.Item3, list_item_11.Item3, list_item_12.Item3])

# ==== cluster Cluster
list = ClusterInput()
curve = ClusterInput()
list_length = ListLength(List=list)
curve_2 = Curve(curve)
list_length_2 = ListLength(List=curve_2)
modulus = Modulus(A=list_length, B=Slider(2, range=0..10))
larger_than = LargerThan(FirstNumber=modulus, SecondNumber=Slider(0, range=0..100))  # -> LargerThan, OrEqualTo
cull_index = CullIndex(List=curve_2, Indices=list_length_2, Wrap=True)
stream_filter = StreamFilter(Gate=larger_than.LargerThan, Stream0=curve_2, Stream1=cull_index)
dispatch = Dispatch(List=stream_filter, DispatchPattern=[True, False])  # -> ListA, ListB
end_points = EndPoints(Curve=dispatch.ListB)  # -> Start, End
end_points_2 = EndPoints(Curve=dispatch.ListA)  # -> Start, End
longest_list = LongestList(PaddingMode=2)  # -> ListListA, ListListB, ListA
shift_list = ShiftList(List=end_points_2.Start, Shift=1, Wrap=False)
line = Line(StartPoint=flatten(end_points_2.End), EndPoint=flatten(end_points.End))
line_2 = Line(StartPoint=shift_list, EndPoint=end_points.Start)
list_length_3 = ListLength(List=line_2)  # -> expr("x-1", Length)
cull_index_2 = CullIndex(List=line_2, Indices=list_length_3, Wrap=True)
join_curves = JoinCurves(Curves=flatten([cull_index_2, line, dispatch.ListB, dispatch.ListA]), Preserve=False)
curves = ClusterOutput(join_curves)
